# Dynamo graph Data Extraction.dyn (Dynamo 2.3.0.5885)

file_path = Filename(".\FamilyData")
string = StringInput("Sheet 1")
number = DoubleInput(294)
number_2 = DoubleInput(0)
categories = Categories("OST_Furniture")
all_elements_of_category = ElementsOfCategory(Category=categories)
exportExcel = Data.ExportExcel(filePath=file_path, sheetName=string, startRow=number, startCol=number_2, data=all_elements_of_category)
file_path_2 = Filename(".\FamilyData")
string_2 = StringInput("Sheet 1")
number_3 = DoubleInput(340)
number_4 = DoubleInput(1)
categories_2 = Categories("OST_ElectricalEquipment")
all_elements_of_category_2 = ElementsOfCategory(Category=categories_2)
exportExcel_2 = Data.ExportExcel(filePath=file_path_2, sheetName=string_2, startRow=number_3, startCol=number_4, data=all_elements_of_category_2)
