# Dynamo graph Data_Extraction_Script.dyn (Dynamo 2.3.0.5885)

file_path = Filename(".\Placement_File.xlsx")
string = StringInput("Sheet1")
number = DoubleInput(1)
number_2 = DoubleInput(1)
categories = Categories("OST_ElectricalEquipment")
all_elements_of_category = ElementsOfCategory(Category=categories)
elementType = Element.ElementType(element=all_elements_of_category)
uniqueItems = List.UniqueItems(list=elementType)
categories_2 = Categories("OST_Furniture")
all_elements_of_category_2 = ElementsOfCategory(Category=categories_2)
elementType_2 = Element.ElementType(element=all_elements_of_category_2)
uniqueItems_2 = List.UniqueItems(list=elementType_2)
categories_3 = Categories("OST_FurnitureSystems")
all_elements_of_category_3 = ElementsOfCategory(Category=categories_3)
elementType_3 = Element.ElementType(element=all_elements_of_category_3)
uniqueItems_3 = List.UniqueItems(list=elementType_3)
categories_4 = Categories("OST_SecurityDevices")
all_elements_of_category_4 = ElementsOfCategory(Category=categories_4)
elementType_4 = Element.ElementType(element=all_elements_of_category_4)
uniqueItems_4 = List.UniqueItems(list=elementType_4)
join = List.Join(list0=uniqueItems, list1=uniqueItems_2, list2=uniqueItems_3, list3=uniqueItems_4)
string_from_object = FromObject(obj=join)
number_3 = DoubleInput(13)
length = String.Length(str=string_from_object)
number_4 = DoubleInput(15)
sub = length - number_4
family = FamilyType.Family(familyType=uniqueItems)
family_2 = FamilyType.Family(familyType=uniqueItems_2)
family_3 = FamilyType.Family(familyType=uniqueItems_3)
family_4 = FamilyType.Family(familyType=uniqueItems_4)
join_2 = List.Join(list0=family, list1=family_2, list2=family_3, list3=family_4)
string_from_object_2 = FromObject(obj=join_2)
length_2 = String.Length(str=string_from_object_2)
sub_2 = sub - length_2
substring = String.Substring(str=string_from_object, startIndex=number_3, length=sub_2)
boolean = BoolSelector(false)
exportExcel = Data.ExportExcel(filePath=file_path, sheetName=string, startRow=number, startCol=number_2, data=substring, overWrite=boolean)
number_5 = DoubleInput(0)
number_6 = DoubleInput(8)
sub_3 = length_2 - number_6
substring_2 = String.Substring(str=string_from_object_2, startIndex=number_6, length=sub_3)
exportExcel_2 = Data.ExportExcel(filePath=file_path, sheetName=string, startRow=number, startCol=number_5, data=substring_2, overWrite=boolean)
