# Dynamo graph MEP_FamilyInstanceFromLinkedModelReference_D2.02.dyn (Dynamo 2.1.0.7500)

# group: Read values from csv reference file
file_path = Filename("..\ElecRef.csv")  # graph input
code_block = CodeBlock { "ElecRef"; }
code_block_2 = CodeBlock()
# ---------- code_block_2.designscript (15 lines) ----------
[


"ARCHITECTURAL_FAMILY_NAME",
"ARCHITECTURAL_FAMILY_TYPE",
"SERVICES_FAMILY_NAME",
"SERVICES_FAMILY_TYPE",
"HORIZONTAL_OFFSET",
"DEPTH_OFFSET",
"ELEVATION",
"ROTATION",
"WORKSET",
"COMMENT"

];
# ----------------------------------------
getColumnsFromHeaders = Custom[GetColumnsFromHeaders](excelFilePath=file_path, sheetName=code_block, fields=code_block_2)  # Get columns based on headers

createKeyValuePairs = Python(IN[0]=getColumnsFromHeaders)
# ---------- createKeyValuePairs.python (100 lines) ----------
# Load the Python Standard and DesignScript Libraries
import sys
import clr
clr.AddReference('ProtoGeometry')
from Autodesk.DesignScript.Geometry import *

# Import DocumentManager and TransactionManager
clr.AddReference("RevitServices")
import RevitServices
from RevitServices.Persistence import DocumentManager
from RevitServices.Transactions import TransactionManager

# Import RevitAPI
clr.AddReference("RevitAPI")
import Autodesk
from Autodesk.Revit.DB import *

# Import Element wrapper extension methods
import clr
clr.AddReference("RevitNodes")
import Revit
clr.ImportExtensions(Revit.Elements)

#the document to operate on
doc = DocumentManager.Instance.CurrentDBDocument

# The inputs to this node will be stored as a list in the IN variables.
archnames = [i + "." + j for i,j in zip(IN[0][0],IN[0][1])]
elecnames = IN[0][2]
electypes = IN[0][3]
horoffs = IN[0][4]
depthoffs = IN[0][5]
elevations = IN[0][6]
rotations = IN[0][7]
worksets = IN[0][8]
comments = IN[0][9]


# outputs required to place families
elecnamevals = []
electypevals = []
horoffvals = []
depthoffvals = []
elevals = []
rotationvals = []
worksetvals = []
commentvals = []

#create unique set of architectural families
keys = []
for archname in archnames:
	if archname not in keys:
		keys.append(archname)

#create value lists for families to be placed at each instance of architectural families
for i, k in enumerate(keys):
	nvalue = []
	tvalue = []
	hvalue = []
	dvalue = []	
	evalue = []
	rvalue = []
	wvalue = []
	cvalue = []
	for j, archname in enumerate(archnames):
		if archname == k:
			nvalue.append(elecnames[j])
			tvalue.append(electypes[j])
			hvalue.append(horoffs[j])
			dvalue.append(depthoffs[j])
			evalue.append(elevations[j])
			rvalue.append(rotations[j])
			wvalue.append(worksets[j])
			cvalue.append(comments[j])
	elecnamevals.append(nvalue)
	electypevals.append(tvalue)	
	horoffvals.append(hvalue)
	depthoffvals.append(dvalue)
	elevals.append(evalue)
	rotationvals.append(rvalue)
	worksetvals.append(wvalue)
	commentvals.append(cvalue)

# turn list of electrical family and type names into list of family symbol objects
docsymbols = FilteredElementCollector(doc).OfClass(FamilySymbol).ToElements()
familynames = [d.FamilyName for d in docsymbols]
typenames = [Element.Name.GetValue(UnwrapElement(d)) for d in docsymbols]

elecsymbols = []

for a, b in zip(elecnamevals, electypevals):
	value = []
	for c, d in zip(a, b):
		for i, f in enumerate(familynames):
			if f == c and typenames[i] == d:
				value.append(docsymbols[i])
	elecsymbols.append(value)

# Assign your output to the OUT variable.
OUT = keys, elecnamevals, electypevals, horoffvals, depthoffvals, elecsymbols, elevals, rotationvals, worksetvals, commentvals
# ----------------------------------------

# group: Select linked model to collect categories from
getDocuments = archilab.Revit.Selection.Select.GetDocuments()
code_block_3 = CodeBlock { 1; }
getItemAtIndex = List.GetItemAtIndex(list=getDocuments.Link_Instance, index=code_block_3)

# group: Create list of categories to be collected from architectural model
categories = Categories("OST_PlumbingFixtures")  # graph input
categories_2 = Categories("OST_ElectricalEquipment")  # graph input
categories_3 = Categories("OST_SpecialityEquipment")  # graph input
list_create = List.Create(item0=categories, item1=categories_2, item2=categories_3)

# group: Collect elements from linked model
linkedInstanceElements = Custom[Springs.Collector.LinkedInstanceElements](LinkInstance=getItemAtIndex, category=list_create)  # Extract elements by category from the selected linked instances. The transform vector can be used to get the exact location of the elements in the local file
flatten = List.Flatten(list=linkedInstanceElements.elements)

# group: Filter out existing fixtures that are being demolished
code_block_4 = CodeBlock(e=flatten) { e; }
phases = Custom[Element.Phases](element=code_block_4)  # Gets the created and demolished phases of an element
isEmpty = List.IsEmpty(list=phases.Demolished@L2)
filterByBoolMask = List.FilterByBoolMask(list=code_block_4, mask=isEmpty)
code_block_5 = CodeBlock(NewConstruction=filterByBoolMask.in) { NewConstruction; }
name = Element.Name(element=phases.Demolished)

code_block_6 = CodeBlock(e=code_block_5) { e; }

# group: Filter by Family and FamilyType in reference list
getFamily = FamilyInstance.GetFamily(familyInstance=code_block_6)
name_2 = Family.Name(family=getFamily)
code_block_7 = CodeBlock(fams=getColumnsFromHeaders, famtypes=getColumnsFromHeaders) { fams[0]; famtypes[1]; }
contains = Custom[String.Contains](StringList=name_2, FilterList=code_block_7.out0)  # This node takes a list of strings and checks if any string contains a matching string from filter input.
name_3 = FamilyType.Name(familyType=code_block_6)
contains_2 = Custom[String.Contains](StringList=name_3, FilterList=code_block_7.out1)
and_ = contains && contains_2
filterByBoolMask_2 = List.FilterByBoolMask(list=code_block_6, mask=and_)

code_block_8 = CodeBlock(elems=filterByBoolMask_2.in) { elems; }

# group: Create Family & Type Key
getFamily_2 = FamilyInstance.GetFamily(familyInstance=code_block_8)
name_4 = Family.Name(family=getFamily_2)
name_5 = FamilyType.Name(familyType=code_block_8)
createKeys = Python(IN[0]=name_4, IN[1]=name_5)
# ---------- createKeys.python (13 lines) ----------
# Load the Python Standard and DesignScript Libraries
import sys
import clr
clr.AddReference('ProtoGeometry')
from Autodesk.DesignScript.Geometry import *

# The inputs to this node will be stored as a list in the IN variables.
archnames = [i + "." + j for i,j in zip(IN[0],IN[1])]



# Assign your output to the OUT variable.
OUT = archnames
# ----------------------------------------

# group: Dictionary mess
code_block_9 = CodeBlock(worksets=createKeyValuePairs) { worksets[8]; }
byName = archilab.Revit.Elements.Workset.ByName(name=code_block_9)
code_block_10 = CodeBlock(keys=createKeyValuePairs) { keys[0]; }
code_block_11 = CodeBlock(familytype=createKeyValuePairs) { familytype[5]; }
byKeysValues = DesignScript.Builtin.Dictionary.ByKeysValues(keys=code_block_10, values=code_block_11)
valueAtKey = DesignScript.Builtin.Dictionary.ValueAtKey(dictionary=byKeysValues, key=createKeys)
code_block_12 = CodeBlock(horoffsets=createKeyValuePairs) { horoffsets[3]; }
byKeysValues_2 = DesignScript.Builtin.Dictionary.ByKeysValues(keys=code_block_10, values=code_block_12)
valueAtKey_2 = DesignScript.Builtin.Dictionary.ValueAtKey(dictionary=byKeysValues_2, key=createKeys)
code_block_13 = CodeBlock(depth=createKeyValuePairs) { depth[4]; }
byKeysValues_3 = DesignScript.Builtin.Dictionary.ByKeysValues(keys=code_block_10, values=code_block_13)
valueAtKey_3 = DesignScript.Builtin.Dictionary.ValueAtKey(dictionary=byKeysValues_3, key=createKeys)
code_block_14 = CodeBlock(rotations=createKeyValuePairs) { rotations[7]; }
byKeysValues_4 = DesignScript.Builtin.Dictionary.ByKeysValues(keys=code_block_10, values=code_block_14)
valueAtKey_4 = DesignScript.Builtin.Dictionary.ValueAtKey(dictionary=byKeysValues_4, key=createKeys)
code_block_15 = CodeBlock(elevations=createKeyValuePairs) { elevations[6]; }
byKeysValues_5 = DesignScript.Builtin.Dictionary.ByKeysValues(keys=code_block_10, values=code_block_15)
valueAtKey_5 = DesignScript.Builtin.Dictionary.ValueAtKey(dictionary=byKeysValues_5, key=createKeys)
byKeysValues_6 = DesignScript.Builtin.Dictionary.ByKeysValues(keys=code_block_10, values=code_block_9)
valueAtKey_6 = DesignScript.Builtin.Dictionary.ValueAtKey(dictionary=byKeysValues_6, key=createKeys)

firstItem = List.FirstItem(list=linkedInstanceElements.transform_s)
code_block_16 = CodeBlock(transformation=firstItem) { transformation; }

# group: Get family location, transform coordinates based on shared coordinate system
getLocation = Element.GetLocation(element=code_block_8)
code_block_17 = CodeBlock(transformation=code_block_16) { transformation; }
transform = Geometry.Transform(geometry=getLocation, cs=code_block_17)

# group: Get family facing vector, transform based on shared coordinate system
facingOrientation = FamilyInstance.FacingOrientation(familyInstance=code_block_8)
code_block_18 = CodeBlock(transformation=code_block_16) { transformation; }
transform_2 = Vector.Transform(vector=facingOrientation, cs=code_block_18)

# group: Create coordinate system at each point - MAYBE NEED TO USE CROSS PRODUCT TO CREATE COORDINATE SYSTEM USING 3 VECTORS?
ZAxis = Vector.ZAxis()
byOriginVectors = CoordinateSystem.ByOriginVectors(origin=transform, xAxis=transform_2, yAxis=ZAxis)
ZAxis_2 = CoordinateSystem.ZAxis(coordinateSystem=byOriginVectors)
XAxis = CoordinateSystem.XAxis(coordinateSystem=byOriginVectors)

# group: Horizontal offset (to move group against wall)
translate = Geometry.Translate(geometry=transform, direction=ZAxis_2, distance=valueAtKey_2)

# group: Horizontal offset (to move group against wall)
translate_2 = Geometry.Translate(geometry=translate, direction=XAxis, distance=valueAtKey_3)

# group: Get host level of arch families
code_block_19 = CodeBlock { "Host"; }
getParameterValueByName = Element.GetParameterValueByName(element=code_block_8, parameterName=code_block_19)
code_block_20 = CodeBlock { 7; -8; }
remove = String.Remove(str=getParameterValueByName, startIndex=code_block_20.out0, count=code_block_20.out1)
byName_2 = WombatDynamo.Level.ByName(name=remove)

byPointAndLevel = FamilyInstance.ByPointAndLevel(familyType=valueAtKey@L2, point=translate_2@L2, level=byName_2)  # frozen

# group: Determine element rotation & account for mirroring of elements
getElementRotation = Custom[GetElementRotation](FamInstance=code_block_8)  # Get the rotation of a family instance whose location is a point.
py = Python(IN[0]=getElementRotation.Rotation, IN[1]=getElementRotation.isXmirrored, IN[2]=getElementRotation.isYmirrored)  # "FixRotationIfMirrored.py"
# ---------- py.python (22 lines) ----------
# Load the Python Standard and DesignScript Libraries
import sys
import clr

# This node determines if an element has been mirrored. If it is mirrored, then the input angle is changed by 180 degrees (but output is always smaller than 360 degrees)

# The inputs to this node will be stored as a list in the IN variables.
rotation = IN[0]
xmirror = IN[1]
ymirror = IN[2]
output = []

for r, x, y in zip(rotation, xmirror, ymirror):
	if x == y and r+180>=360:
		output.append(r-180)
	elif x == y and r+180<360:
		output.append(r+180)
	else:
		output.append(r)

# Assign your output to the OUT variable.
OUT = output
# ----------------------------------------

code_block_21 = CodeBlock(x=valueAtKey_4, y=py) { x+y; }

# group: Set Parameters
setRotation = FamilyInstance.SetRotation(familyInstance=byPointAndLevel@L2, degree=code_block_21@L2)
code_block_22 = CodeBlock { "Elevation from Level"; }
setParameterByName = Element.SetParameterByName(element=setRotation, parameterName=code_block_22, value=valueAtKey_5)
code_block_23 = CodeBlock { "Workset"; }
IDFromName = WombatDynamo.Workset.IDFromName(name=valueAtKey_6)
setParameterByName_2 = Element.SetParameterByName(element=setParameterByName, parameterName=code_block_23, value=IDFromName)

# group: Collect Family Types and Names, write new reference CSV
file_path_2 = Filename("..\HydRef.csv")  # graph input; frozen
getFamily_3 = FamilyInstance.GetFamily(familyInstance=code_block_5)
name_6 = Family.Name(family=getFamily_3)
name_7 = FamilyType.Name(familyType=code_block_5)
py_2 = Python(IN[0]=name_6, IN[1]=name_7)  # "UniqueFamilyNameAndTypes.py"
# ---------- py_2.python (23 lines) ----------
# Load the Python Standard and DesignScript Libraries
import sys
import clr
clr.AddReference('ProtoGeometry')
from Autodesk.DesignScript.Geometry import *

# The inputs to this node will be stored as a list in the IN variables.
name = IN[0]
type = IN[1]

testlist = []
uniquename = ["ARCHITECTURAL_FAMILY_NAME"]
uniquetype = ["ARCHITECTURAL_FAMILY_TYPE"]

for i, (n, t) in enumerate(zip(name, type)):
	testval = n + t
	if testval not in testlist:
		testlist.append(testval)
		uniquename.append(n)
		uniquetype.append(t)
	
# Assign your output to the OUT variable.
OUT = uniquename, uniquetype, ["SERVICES_FAMILY_NAME"],["SERVICES_FAMILY_TYPE"], ["HORIZONTAL_OFFSET"], ["DEPTH_OFFSET"], ["ELEVATION"], ["WORKSET"]
# ----------------------------------------
transpose = List.Transpose(lists=py_2)
exportCSV = Data.ExportCSV(filePath=file_path_2, data=transpose)

getFamily_4 = FamilyInstance.GetFamily(familyInstance=code_block_8)
isInPlace = Custom[Family.IsInPlace](family=getFamily_4)  # Determines if a family is an in-place family
code_block_24 = CodeBlock(comments=createKeyValuePairs) { comments[9]; }
byKeysValues_7 = DesignScript.Builtin.Dictionary.ByKeysValues(keys=code_block_10, values=code_block_24)
valueAtKey_7 = DesignScript.Builtin.Dictionary.ValueAtKey(dictionary=byKeysValues_7, key=createKeys)
