# Dynamo graph Placement_Script.dyn (Dynamo 2.3.0.5885)
# packages: LunchBox for Dynamo 2018.7.6, SteamNodes 1.2.4

# group: Import Excel Data
file_path = Filename(".\Placement_File.xlsx")
file_from_path = FileObject(path=file_path)
code_block = CodeBlock { "Sheet1"; }
importExcel = Data.ImportExcel(file=file_from_path, sheetName=code_block)
restOfItems = List.RestOfItems(list=importExcel)
transpose = List.Transpose(lists=restOfItems)

number = DoubleInput(4)
getItemAtIndex = List.GetItemAtIndex(list=transpose, index=number)
number_2 = DoubleInput(5)
getItemAtIndex_2 = List.GetItemAtIndex(list=transpose, index=number_2)
byElementAndOffset = Tag.ByElementAndOffset()  # unwired: view, element
lunchbox_room_element_collector = Custom[LunchBox Room Element Collector]()  # package LunchBox for Dynamo; Collects rooms from the Revit document; unwired: Toggle

# group: Identify Elec Family Types
number_3 = DoubleInput(2)
getItemAtIndex_3 = List.GetItemAtIndex(list=transpose, index=number_3)
number_4 = DoubleInput(3)
getItemAtIndex_4 = List.GetItemAtIndex(list=transpose, index=number_4)
byFamilyNameAndTypeName = FamilyType.ByFamilyNameAndTypeName(familyName=getItemAtIndex_3, typeName=getItemAtIndex_4)

number_5 = DoubleInput(0)
replaceNulls = Lists.Manage.ReplaceNulls(Data=byFamilyNameAndTypeName, ReplaceWith=number_5)
allIndicesOf = List.AllIndicesOf(list=replaceNulls, item=number_5)
removeItemAtIndex = List.RemoveItemAtIndex(list=byFamilyNameAndTypeName, indices=allIndicesOf)

# group: Identify Arch Family Types
number_6 = DoubleInput(0)
getItemAtIndex_5 = List.GetItemAtIndex(list=transpose, index=number_6)
number_7 = DoubleInput(1)
getItemAtIndex_6 = List.GetItemAtIndex(list=transpose, index=number_7)
byFamilyNameAndTypeName_2 = FamilyType.ByFamilyNameAndTypeName(familyName=getItemAtIndex_5, typeName=getItemAtIndex_6)

removeItemAtIndex_2 = List.RemoveItemAtIndex(list=byFamilyNameAndTypeName_2, indices=allIndicesOf)

# group: Place and Orientate Outlets
byFamilyType = FamilyInstance.ByFamilyType(familyType=removeItemAtIndex_2)
levels = Levels("GROUND LEVEL")
facingOrientation = FamilyInstance.FacingOrientation(familyInstance=byFamilyType)
code_block_2 = CodeBlock(input=facingOrientation) { OrientationtoRotation(input); }
number_8 = DoubleInput(-90)
add = code_block_2 + number_8

code_block_3 = CodeBlock()
# ---------- code_block_3.designscript (6 lines) ----------
"
lst = IN[0]
lst2 = [item[0] for item in lst]

OUT = lst2
";
# ----------------------------------------

# group: Identify Walls within Proximity to Architectural Elements
all_elements_of_family_type = ElementsOfFamilyType(Family_Type=removeItemAtIndex_2)
categories = Categories("OST_Walls")
all_elements_of_category = ElementsOfCategory(Category=categories)
number_9 = DoubleInput(0.5)

# group: Flatten Matrix to List
code_block_4 = CodeBlock()
# ---------- code_block_4.designscript (6 lines) ----------
"
data = IN[0]
OUT = []
for x in data:
	OUT += x
";
# ----------------------------------------
python_script_from_string = PythonStringNode(script=code_block_4, IN[0]=all_elements_of_family_type)

getSurroundingElements = Custom[Tool.GetSurroundingElements](python_script_from_string, ElementCheck=all_elements_of_category, Tolerance=number_9)  # package SteamNodes; Get Surrounding Elements by Categories, group them as List. Tolerance distance available.
python_script_from_string_2 = PythonStringNode(script=code_block_3, IN[0]=getSurroundingElements)
setDifference = List.SetDifference(list1=byFamilyType, list2=python_script_from_string_2)

# group (continued): Place and Orientate Outlets
location = FamilyInstance.Location(familyInstance=setDifference)
translate = Geometry.Translate(geometry=location)
byPointAndLevel = FamilyInstance.ByPointAndLevel(familyType=removeItemAtIndex, point=translate, level=levels)
setRotation = FamilyInstance.SetRotation(familyInstance=byPointAndLevel, degree=add)

getRotation = CodeBlock()  # "Orientation.GetRotation"
# ---------- getRotation.designscript (6 lines) ----------
def OrientationtoRotation(inputVector)
{
division = (inputVector.X/inputVector.Length);
rotation = Math.Acos(division);
return rotation;
};
# ----------------------------------------

# group: Find Closest Wall Element
code_block_5 = CodeBlock()
# ---------- code_block_5.designscript (6 lines) ----------
"
item = IN[0]
val = IN[1]
idx = val.index(min(val))
OUT = item[idx]
";
# ----------------------------------------
getLocation = Element.GetLocation(element=all_elements_of_category)
distanceTo = Geometry.DistanceTo(geometry=getLocation, other=location)
python_script_from_string_3 = PythonStringNode(script=code_block_5, IN[0]=all_elements_of_category, IN[1]=distanceTo)

family_types = FamilyTypes("AU_EF_O_GPO_STARTER SOCKET:Non-Essential")
code_block_6 = CodeBlock()
# ---------- code_block_6.designscript (6 lines) ----------
"
lst = IN[0]
lst2 = [item[1] for item in lst]

OUT = lst2
";
# ----------------------------------------
getLocation_2 = Element.GetLocation(element=getSurroundingElements)
python_script_from_string_4 = PythonStringNode(script=code_block_6, IN[0]=getLocation_2)
startPoint = Curve.StartPoint(curve=python_script_from_string_4)
code_block_7 = CodeBlock()  # same code as code_block_3
python_script_from_string_5 = PythonStringNode(script=code_block_7, IN[0]=getLocation_2)
distanceTo_2 = Geometry.DistanceTo(geometry=startPoint, other=python_script_from_string_5)
number_10 = DoubleInput(2)
pow = Math.Pow(number=distanceTo_2, power=number_10)
distanceTo_3 = Geometry.DistanceTo(geometry=python_script_from_string_5, other=python_script_from_string_4)
number_11 = DoubleInput(2)
pow_2 = Math.Pow(number=distanceTo_3, power=number_11)
sub = pow - pow_2
sqrt = Math.Sqrt(number=sub)
pointAtSegmentLength = Curve.PointAtSegmentLength(curve=python_script_from_string_4, segmentLength=sqrt)
byStartPointEndPoint = Line.ByStartPointEndPoint(startPoint=pointAtSegmentLength, endPoint=python_script_from_string_5)
number_12 = DoubleInput(200)
pointAtSegmentLength_2 = Curve.PointAtSegmentLength(curve=byStartPointEndPoint, segmentLength=number_12)
levels_2 = Levels("GROUND LEVEL")
byPointAndLevel_2 = FamilyInstance.ByPointAndLevel(familyType=family_types, point=pointAtSegmentLength_2, level=levels_2)
endPoint = Curve.EndPoint(curve=python_script_from_string_4)
byTwoPoints = Vector.ByTwoPoints(start=startPoint, end=endPoint)
YAxis = Vector.YAxis()
ZAxis = Vector.ZAxis()
angleAboutAxis = Vector.AngleAboutAxis(vector=byTwoPoints, otherVector=YAxis, rotationAxis=ZAxis)
number_13 = DoubleInput(-90)
add_2 = angleAboutAxis + number_13
setRotation_2 = FamilyInstance.SetRotation(familyInstance=byPointAndLevel_2, degree=add_2)
asVector = Point.AsVector(point=pointAtSegmentLength)
byTwoPoints_2 = Vector.ByTwoPoints(start=startPoint, end=endPoint)
ZAxis_2 = Vector.ZAxis()
angleAboutAxis_2 = Vector.AngleAboutAxis(vector=asVector, otherVector=byTwoPoints_2, rotationAxis=ZAxis_2)
number_14 = DoubleInput(90)
div = angleAboutAxis_2 / number_14
round = Math.Round(number=div)
mul = round * number_14
translate_2 = Geometry.Translate()  # unwired: geometry
facingOrientation_2 = FamilyInstance.FacingOrientation(familyInstance=setDifference)
